vi "Get Hostname.gviweb"   [LabVIEW NXG 3.1.0]
inputs:
  "minionID": string
  "configuration in": "Configuration.gtype"
  "error in": error
outputs:
  "Hostname": string
  "configuration out": "Configuration.gtype"
  "error out": error
  "Connection": string
panel indicators:
  "body": string
types:
  "Client Handle.gtype" = u32
  "Configuration.gtype" = cluster{"Server URL": string, "Session": "Client Handle.gtype"}
  T1 = cluster{"_id": cluster{"$oid": string}, "connected": cluster{"state": i32}, "grains": cluster{"data": cluster{"localhost": string}}}
uses:
  NI::HTTP::POST Buffer.gvi
diagram:
  $"configuration out" <- $"configuration in"
  Property Node(instance in=$"configuration in") -> ("Session"=w1, "Server URL"=w2)
  Concatenate Strings(w2, "/nisysmgmt/v1/systems/managed/query") -> w3
  w4 = "\"\n         ]\n      }\n   },\n   \"projection\":{  \n      \"grains.data.localhost\":true,\n      \"connected.state\":true\n   }\n}"
  w5 = "{  \n   \"filter\":{  \n      \"id\":{  \n         \"$in\":[\n\""
  Concatenate Strings(w5, $minionID, w4) -> w6
  call "POST Buffer.gvi"(client handle=w1, url=w3, buffer=w6, error in=$"error in") -> (body=w7, error out=w8)
  $body <- w7
  w9 = cluster{"status_code": i32, "result": T1[]} {all zero or empty}
  Unflatten From JSON(JSON string=w7, default null elements=TRUE, error in (no error)=w8, type and defaults=w9) -> (error out=w10, value=w11)
  Property Node(instance in=w11) -> ("result"=w12)
  Array Index(array=w12) -> (out0[_]=w13)
  Property Node(instance in=w13) -> ("grains:data:localhost"=w14, "connected:state"=w15)
  $Hostname <- w14
  case (w15) {
    frame 0, Default {
      w16 = "Disconnected"
    }
    frame 1 {
      w16 = "Connecting"
    }
    frame 2 {
      w16 = "Connected"
    }
  }
  $Connection <- w16
  $"error out" <- w10
