vi "Main.gviweb"   [LabVIEW NXG 3.1.0]
panel controls:
  "Send Log": bool
  "Stop Test": bool
  "Start Test": bool
  "System": i32
panel indicators:
  "Files Sent": f64
  "Buffer": f64
  "Temperature History": f64[][]
  "Testing": bool
  "System Status": string
  "Memory Percentage Used": f64
  "Disk Percentage Used": f64
  "Temperature Current Values": f64[]
  "Application Status": string
  "Last Updated": timestamp
uses:
  NI::Skyline::Configuration::Open Configuration.gvi
  Application::Filter Systems by Package.gviweb
  Application::Get Minion ID.gviweb
  Application::Get Hostname.gviweb
  NI::Skyline::TagHTTP::Configure Tag History Window (Count).gvi
  NI::Skyline::TagHTTP::Multi Read History.gvi
  NI::Skyline::TagHTTP::Multi Read.gvi
  NI::Skyline::MessageHTTP::Open.gvi
  NI::Skyline::MessageHTTP::Publish.gvi
  NI::Skyline::MessageHTTP::Close.gvi
diagram:
  w1 = ""  # Server
  call "Open Configuration.gvi"(server url=w1, username="", password="") -> (configuration=w2, error out=w3)
  call "Filter Systems by Package.gviweb"(configuration in=w2, package="crio-test-cell", error in=w3) -> (configuration out=w4, systems=w5, error out=w6)
  for {
    w7 = each element of w5
    Property Node(instance in=w7) -> ("grains:data:host"=w9)
    append w9 to w8
  }
  Sort 1D Array(array=w8) -> (sorted array=w10)
  Property Node(instance in=reference to "System", "Items"=w10, "Value"=0, error in=w6) -> (error out=w11)
  while {
    Property Node(instance in=reference to "System", error in=w11) -> ("Items"=w12)
    Array Index(array=w12) -> (out0[$System]=w13)
    call "Get Minion ID.gviweb"(configuration in=w4, hostname=w13) -> (configuration out=w14, id=w15, error out=w16)
    event (timeout = 500) {
      on Timeout {
        call "Get Hostname.gviweb"(configuration in=w14, minionID=w15, error in=w16) -> (configuration out=w17, Connection=w18, error out=w19)
        case (w18) {
          frame "Disconnected", Default {
            Property Node(instance in=reference to "Testing", "Value"=FALSE)
            w20 = TRUE
          }
          frame "Connected" {
            Get Current Time() -> (current time=w21)
            call "Read AI.gviweb"(configuration=w17, minion id=w15) -> (tags=w22, number of tags=w23)
            Time Stamp Subtract(x=w21, y=1000) -> w24
            case (w23) {
              frame 0 {
                w25 = f64[][] []
                w26 = f64[] []
              }
              frame 1, Default {
                call "Configure Tag History Window (Count).gvi"(start=w24, end=w21, newest first?=FALSE) -> (history window=w27)
                call "Multi Read History.gvi"(tags in=w22, tag history window=w27) -> (values=w28)
                call "Multi Read.gvi"(tags in=w22) -> (tag clusters=w29)
                for {
                  w30 = each element of w28
                  w31 = each element of w29
                  Property Node(instance in=w30) -> ("Values"=w32)
                  for {
                    w33 = each element of w32
                    Scan Value(format string="%f", string=w33) -> (value=w35)
                    append w35 to w34
                  }
                  Property Node(instance in=w31) -> ("Value"=w36)
                  Scan Value(format string="%f", string=w36) -> (value=w37)
                  append w34 to w25
                  append w37 to w26
                }
              }
            }
            $"Temperature History" <- w25
            $"Temperature Current Values" <- w26
            call "Read Health.gviweb"(configuration=w17, minion id=w15) -> (tags=w38)
            for {
              w39 = each element of w38
              Property Node(instance in=w39) -> ("Path"=w40, "Value"=w41, "Time Stamp"=w42)
              Search Or Split String(search string/char=".", string=w40) -> (match + rest of string=w43)
              case (w43) {
                frame ".Health.Disk.UsePercentage" {
                  Scan Value(format string="%f", string=w41) -> (value=w44)
                  $"Disk Percentage Used" <- w44
                }
                frame ".Health.Memory.UsePercentage" {
                  Scan Value(format string="%f", string=w41) -> (value=w45)
                  $"Memory Percentage Used" <- w45
                }
                frame ".cRIO_Test_Cell.files_sent" {
                  Scan Value(format string="%d", string=w41) -> (value=w46)
                  $"Files Sent" <- w46
                }
                frame ".cRIO_Test_Cell.buffer" {
                  Scan Value(format string="%d", string=w41) -> (value=w47)
                  $Buffer <- w47
                }
                frame ".cRIO_Test_Cell.testing" {
                  case (w41) {
                    frame "False", Default {
                      w48 = FALSE
                    }
                    frame "True" {
                      w48 = TRUE
                    }
                  }
                  $Testing <- w48
                }
                frame ".cRIO_Test_Cell.status" {
                  $"Application Status" <- w41
                  $"Last Updated" <- w42
                }
                frame Default { }
              }
            }
            w20 = FALSE
          }
        }
        Property Node(instance in=reference to "Stop Test", "Disabled"=w20)
        $"System Status" <- w18
        Property Node(instance in=reference to "Start Test", "Disabled"=w20)
        Property Node(instance in=reference to "Send Log", "Disabled"=w20)
      }
      on "Send Log" Value changed {
        call "Open.gvi"(configuration=w14) -> (message session out=w49, error out=w50)
        call "Publish.gvi"(message session=w49, topic=w15, message="Send File", error in=w50) -> (message session out=w51, error out=w52)
        call "Close.gvi"(message session=w51, error in=w52)
      }
      on "Start Test" Value changed {
        call "Open.gvi"(configuration=w14) -> (message session out=w53, error out=w54)
        call "Publish.gvi"(message session=w53, topic=w15, message="Start Test", error in=w54) -> (message session out=w55, error out=w56)
        call "Close.gvi"(message session=w55, error in=w56)
      }
      on "Stop Test" Value changed {
        call "Open.gvi"(configuration=w14) -> (message session out=w57, error out=w58)
        call "Publish.gvi"(message session=w57, topic=w15, message="Stop Test", error in=w58) -> (message session out=w59, error out=w60)
        call "Close.gvi"(message session=w59, error in=w60)
      }
      on "System" Value changed {
        Property Node(instance in=reference to "Files Sent", "Value"=0)
        Property Node(instance in=reference to "Buffer", "Value"=0)
        Property Node(instance in=reference to "Application Status", "Value"="")
        Property Node(instance in=reference to "Testing", "Value"=FALSE)
        Property Node(instance in=reference to "Last Updated", "Value"=1904-01-01T00:00:00Z)
      }
    }
    stop if FALSE
  }
