vi "Read AI.gviweb"   [LabVIEW NXG 3.1.0]
inputs:
  "configuration": "Configuration.gtype"
  "minion id": string
  "Error Out": error
outputs:
  "tags": "Tag.gtype"[]
  "number of tags": i32
  "Error In": error
types:
  "Client Handle.gtype" = u32
  "Configuration.gtype" = cluster{"Server URL": string, "Session": "Client Handle.gtype"}
  "DataType.gtype" = enum{"Double", "I32", "String", "Boolean", "U64", "Timestamp"}
  "Tag.gtype" = cluster{"Path": string, "Datatype": "DataType.gtype", "Configuration": "Configuration.gtype"}
uses:
  NI::Skyline::TagHTTP::Query Tags.gvi
diagram:
  Concatenate Strings($"minion id", ".", "cRIO_Test_Cell.mod1.*") -> w1
  Build Array(w1) -> w2
  call "Query Tags.gvi"(paths=w2, error in=$"Error Out", configuration=$configuration) -> (tags=w3, error out=w4)
  $tags <- w3
  Array Size(array=w3) -> (size(s)=w5)
  $"number of tags" <- w5
  $"Error In" <- w4
