vi "Read Health.gviweb"   [LabVIEW NXG 5.1.0]
inputs:
  "configuration": "Configuration.gtype"
  "minion id": string
  "error in": error
outputs:
  "tags": "Tag Value Cluster.gtype"[]
  "error out": error
types:
  "Client Handle.gtype" = u32
  "Workspace.gtype" = cluster{"id": string, "name": string, "archived?": bool, "default?": bool}
  "Configuration.gtype" = cluster{"Server URL": string, "Session": "Client Handle.gtype", "Raw Session Queue": Queue<"Client Handle.gtype">, "Workspace": "Workspace.gtype"}
  "DataType.gtype" = enum{"Double", "I32", "String", "Boolean", "U64", "Timestamp"}
  "Tag Value Cluster.gtype" = cluster{"Path": string, "Workspace ID": string, "Data Type": "DataType.gtype", "Value": string, "Time Stamp": timestamp}
uses:
  NI::Skyline::TagHTTP::Query Tags.gvi
  NI::Skyline::TagHTTP::Multi Read.gvi
diagram:
  w1 = ["Health.Disk.UsePercentage", "Health.Memory.UsePercentage", "cRIO_Test_Cell.files_sent", "cRIO_Test_Cell.buffer", "cRIO_Test_Cell.testing", "cRIO_Test_Cell.status", "TestMonitor.0.Status"]
  for {
    w2 = each element of w1
    Concatenate Strings($"minion id", ".", w2) -> w4
    append w4 to w3
  }
  call "Query Tags.gvi"(paths=w3, error in=$"error in", configuration=$configuration) -> (tags=w5, error out=w6)
  call "Multi Read.gvi"(tags in=w5, error in=w6) -> (tag clusters=w7, error out=w8)
  $tags <- w7
  $"error out" <- w8
